# Dynamo graph DSRevitNodesUI.PerformanceAdviserRules.dyn (Dynamo 3.4.1.7055)

performance_adviser_rules = PerformanceAdviserRules("Overlapping walls")
performance_adviser_rules_2 = PerformanceAdviserRules("Room separation line is not joined")
list_create = List.Create(item0=performance_adviser_rules, item1=performance_adviser_rules_2)
execute = PerformanceAdviserRule.Execute(rules=list_create)
