# Dynamo graph Revit.Application.FamilyDocument.AddParameter.dyn (Dynamo 2.18.1.5096)

current = Document.Current()
byDocument = FamilyDocument.ByDocument(document=current)
string = StringInput("Warehouse Id")
group_types = GroupTypes("autodesk.parameter.group:identityData")
spec_types = SpecTypes("autodesk.spec:spec.string")
boolean = BoolSelector(false)
addParameter = FamilyDocument.AddParameter(familyDocument=byDocument, parameterName=string, groupType=group_types, specType=spec_types, isInstance=boolean)
