# Dynamo graph Revit.Elements.Element.GetHostedElements.dyn (Dynamo 3.2.1.5366)

categories = Categories("OST_Walls")
views = Views("L2")
all_elements_of_category_in_view = ElementsOfCategoryInView(Category=categories, View=views)
string = StringInput("Revit.Elements.Wall")
# note: Removes in place families
removeIfNot = List.RemoveIfNot(list=all_elements_of_category_in_view, type=string)
getHostedElements = Element.GetHostedElements(element=removeIfNot)
isEmpty = List.IsEmpty(list=getHostedElements@L2)
filterByBoolMask = List.FilterByBoolMask(list=removeIfNot, mask=isEmpty)
walls_that_have_doors = Watch(filterByBoolMask.out)
walls_without_doors = Watch(filterByBoolMask.in)
