# Dynamo graph Revit.Elements.Room.Number.dyn (Dynamo 2.18.1.5096)

categories = Categories("OST_Rooms")
all_elements_of_category = ElementsOfCategory(Category=categories)
name = Room.Name(room=all_elements_of_category)
number = Room.Number(room=all_elements_of_category)
