# Dynamo graph Revit.Elements.Parameter.Value.dyn (Dynamo 3.2.1.5366)

categories = Categories("OST_Walls")
all_elements_of_category = ElementsOfCategory(Category=categories)
firstItem = List.FirstItem(list=all_elements_of_category)
parameters = Element.Parameters(element=firstItem)
value = Parameter.Value(parameter=parameters)
