# Dynamo graph Get Geometry For All Elements Of Category.dyn (Dynamo 3.4.0.6892)
# author: Autodesk
# Alle Elemente einer ausgewählten Kategorie sammeln (vorgabemäßig auf Türen eingestellt) und Geometrie der einzelnen Elemente abrufen

# note: Revit-Kategorie auswählen
# note: We recommend you save your graph with a category you expect to exist in your models to prevent a warning.
# For example, try saving and running the graph with the Doors category on the sample model Snowdon Towers Sample Architectural.rvt, available at:
# C:\Program Files\Autodesk\<Revit ....>\Samples
kategorien = Categories("OST_Doors")
# note: Alle Elemente der ausgewählten Kategorie sammeln
alle_elemente_der_kategorie = ElementsOfCategory(Category=kategorien)
# note: Rufen Sie die Geometrie aller gesammelten Elemente ab, wo möglich. Es wird möglicherweise eine Warnung ausgegeben, und null wird zurückgegeben, wenn in Revit Daten fehlen oder die Geometrie nicht auflösbar ist
geometry = Element.Geometry(element=alle_elemente_der_kategorie)
