# Dynamo graph Get Geometry For All Elements Of Category.dyn (Dynamo 3.4.0.6892)
# author: Autodesk
# Raccoglie tutti gli elementi della categoria scelta (l'impostazione di default è Porte) e ottiene la geometria di ogni elemento.

# note: Selezionare la categoria di Revit
# note: We recommend you save your graph with a category you expect to exist in your models to prevent a warning.
# For example, try saving and running the graph with the Doors category on the sample model Snowdon Towers Sample Architectural.rvt, available at:
# C:\Program Files\Autodesk\<Revit ....>\Samples
categorie = Categories("OST_Doors")
# note: Raccogliere tutti gli elementi della categoria selezionata
tutti_gli_elementi_della = ElementsOfCategory(Category=categorie)  # "Tutti gli elementi della categoria"
# note: Ottenere la geometria di tutti gli elementi raccolti, laddove possibile. È possibile che venga restituito un avviso e che sia nullo se in Revit manca qualcosa o se la geometria non è risolvibile
geometry = Element.Geometry(element=tutti_gli_elementi_della)
