# Dynamo graph Get Geometry For All Elements Of Category.dyn (Dynamo 3.4.0.6892)
# author: Autodesk
# 選択したカテゴリ(既定はドア)のすべての要素を収集し、各要素のジオメトリを取得します

# note: Revit カテゴリを選択
# note: We recommend you save your graph with a category you expect to exist in your models to prevent a warning.
# For example, try saving and running the graph with the Doors category on the sample model Snowdon Towers Sample Architectural.rvt, available at:
# C:\Program Files\Autodesk\<Revit ....>\Samples
カテゴリ = Categories("OST_Doors")
# note: 選択したカテゴリのすべての要素を収集
カテゴリのすべての要素 = ElementsOfCategory(Category=カテゴリ)
# note: 可能な場合は、収集されたすべての要素のジオメトリを取得します。Revit で何かが見つからない場合や、ジオメトリが解決できない場合は、警告と null が返される場合があります。
geometry = Element.Geometry(element=カテゴリのすべての要素)
