# Dynamo graph Get Geometry For All Elements Of Category.dyn (Dynamo 3.4.0.6892)
# author: Autodesk
# 선택한 카테고리의 모든 요소(기본값: 문)를 수집하고 각 요소의 형상을 가져옵니다.

# note: Revit 카테고리 선택
# note: We recommend you save your graph with a category you expect to exist in your models to prevent a warning.
# For example, try saving and running the graph with the Doors category on the sample model Snowdon Towers Sample Architectural.rvt, available at:
# C:\Program Files\Autodesk\<Revit ....>\Samples
카테고리 = Categories("OST_Doors")
# note: 선택한 카테고리의 모든 요소 수집
카테고리의_모든_요소 = ElementsOfCategory(Category=카테고리)
# note: 가능한 경우 수집된 모든 요소의 형상을 가져옵니다. 그러면 경고가 반환될 수 있고 Revit에서 누락된 항목이 있거나 형상을 해석할 수 없는 경우 null이 반환됩니다.
geometry = Element.Geometry(element=카테고리의_모든_요소)
