# Dynamo graph Get Geometry For All Elements Of Category.dyn (Dynamo 3.4.0.6892)
# author: Autodesk
# 收集所选类别的所有图元(默认为门)并获取每个图元几何图形

# note: 选择 Revit 类别
# note: We recommend you save your graph with a category you expect to exist in your models to prevent a warning.
# For example, try saving and running the graph with the Doors category on the sample model Snowdon Towers Sample Architectural.rvt, available at:
# C:\Program Files\Autodesk\<Revit ....>\Samples
类别 = Categories("OST_Doors")
# note: 收集该选定类别的所有图元
以下类别的所有图元 = ElementsOfCategory(Category=类别)
# note: 获取所有收集图元的几何图形(如果可能)。如果 Revit 中缺少内容，它可能会返回警告和空值，或者几何图形无法解析
geometry = Element.Geometry(element=以下类别的所有图元)
