# Dynamo graph Get Geometry For All Elements Of Category.dyn (Dynamo 3.4.0.6892)
# author: Autodesk
# 收集所選品類 (預設為房間) 的所有元素，並取得每個元素的幾何圖形

# note: 選取 Revit 品類
# note: We recommend you save your graph with a category you expect to exist in your models to prevent a warning.
# For example, try saving and running the graph with the Doors category on the sample model Snowdon Towers Sample Architectural.rvt, available at:
# C:\Program Files\Autodesk\<Revit ....>\Samples
categories = Categories("OST_Doors")
# note: 收集該所選品類的所有元素
all_elements_of_category = ElementsOfCategory(Category=categories)
# note: 盡可能取得所有已收集元素的幾何圖形。如果 Revit 中缺少某些內容，或幾何圖形無法解析，則可能會傳回警告和空值
geometry = Element.Geometry(element=all_elements_of_category)
