# Dynamo graph TextNote.dyn (Dynamo 1.1.1.2204)

# group: View
current = Document.Current()
activeView = Document.ActiveView(current)

# group: Geometry
byCoordinates = Point.ByCoordinates()

code_block = CodeBlock { "Hello World"; }
center = Autodesk.Revit.DB.HorizontalTextAlignment.Center()
default = TextNoteType.Default()
byLocation = TextNote.ByLocation(activeView, byCoordinates, code_block, center, default)

# group: Properties
verticalAlignment = TextNote.VerticalAlignment(byLocation)
text = TextNote.Text(byLocation)
horizontalAlignment = TextNote.HorizontalAlignment(byLocation)
typename = TextNote.Typename(byLocation)
height = TextNote.Height(byLocation)
