# Dynamo graph StructuralFoundationTest.dyn (Dynamo 0.8.3.2362)

select_model_element = DSModelElementSelection()  # 1 picked in the model
location = FamilyInstance.Location(select_model_element)
watch = Watch(location)
