# Dynamo graph CurtainSystem.dyn (Dynamo 1.2.1.2802)

select_face = DSFaceSelection()  # 1 picked in the model
code_block = CodeBlock { "5' x 10'"; }
byName = CurtainSystemType.ByName(code_block)
byFaces = CurtainSystem.ByFaces(select_face, byName)
