# Dynamo graph ByReferences.dyn (Dynamo 2.8.0.2195)

views = Views("Level 1")
select_face = DSFaceSelection()  # 1 picked in the model
bySurface = Revit.GeometryReferences.ElementFaceReference.BySurface(surface=select_face)
select_edge = DSEdgeSelection()  # 1 picked in the model
byCurve = Revit.GeometryReferences.ElementCurveReference.ByCurve(curve=select_edge)
list_create = List.Create(item0=bySurface, item1=byCurve)
flatten = List.Flatten(list=list_create)
select_edge_2 = DSEdgeSelection()  # 1 picked in the model
byReferences = Dimension.ByReferences(view=views, referenceGeometries=flatten, line=select_edge_2)
