# Dynamo graph RebindingMultiDimension.dyn (Dynamo 0.8.1.1047)

number = DoubleInput(5)
code_block = CodeBlock(end=number) { Autodesk.Point.ByCoordinates((0..end)<1>, (0..end)<2>,0); }
byPoint = ReferencePoint.ByPoint(code_block)
