# Dynamo graph RebindingSingleDimension.dyn (Dynamo 1.0.1.1821)

number = DoubleInput(5)
code_block = CodeBlock(end=number) { Autodesk.Point.ByCoordinates(0..end, 0,0); }
byPoint = ReferencePoint.ByPoint(code_block)
