# Dynamo graph CanCreateElevationViewsByMarkerIndex.dyn (Dynamo 2.5.0.7460)

select_model_element = DSModelElementSelection()  # 1 picked in the model
views = Views("Level 0")
code_block = CodeBlock { 0; }
createElevationByMarkerIndex = ElevationMarker.CreateElevationByMarkerIndex(elevationMarker=select_model_element, planView=views, index=code_block)
name = Element.Name(element=createElevationByMarkerIndex)
