# Dynamo graph CanGetFamilyDocumentParameterValue.dyn (Dynamo 2.6.0.7593)

current = Document.Current()
byDocument = FamilyDocument.ByDocument(document=current)
code_block = CodeBlock { "Depth"; }
getParameterValueByName = FamilyDocument.GetParameterValueByName(familyDocument=byDocument, parameterName=code_block)
