# Dynamo graph CanGetFamilyDocumentValue.dyn (Dynamo 2.6.0.7237)

current = Document.Current()
byDocument = FamilyDocument.ByDocument(document=current)
code_block = CodeBlock { "Depth"; }
getValue = FamilyDocument.GetValue(familyDocument=byDocument, parameter=code_block)
