# Dynamo graph CanSetFamilyDocumentValue.dyn (Dynamo 2.6.0.7237)

current = Document.Current()
byDocument = FamilyDocument.ByDocument(document=current)
code_block = CodeBlock { "Width"; 2000.0; }
setValue = FamilyDocument.SetValue(familyDocument=byDocument, parameter=code_block.out0, value=code_block.out1)
