# Dynamo graph Level.dyn (Dynamo 0.8.0.706)

number = DoubleInput(0..10..2)
concat = String.Concat()
string = StringInput("Level ")
create_list = List.Create(string)
string_from_object = FromObject(number)
cartesianProduct = List.CartesianProduct(concat, create_list, string_from_object)
byElevationAndName = Level.ByElevationAndName(number, cartesianProduct, lacing=Longest)
count = List.Count(number)
