# Dynamo graph TestMigration_Analyze_Display.dyn (Dynamo 1.0.1.1922)

current = Document.Current()
activeView = Document.ActiveView(current)
byViewPointsAndValues = Revit.AnalysisDisplay.PointAnalysisDisplay.ByViewPointsAndValues(activeView)
current_2 = Document.Current()
activeView_2 = Document.ActiveView(current_2)
byViewFacePointsAndValues = Revit.AnalysisDisplay.FaceAnalysisDisplay.ByViewFacePointsAndValues(activeView_2)
current_3 = Document.Current()
activeView_3 = Document.ActiveView(current_3)
byViewPointsAndVectorValues = Revit.AnalysisDisplay.VectorAnalysisDisplay.ByViewPointsAndVectorValues(activeView_3)
