# Dynamo graph DuplicateSheet.dyn (Dynamo 2.8.0.2195)

sheets = Sheets("Title Sheet")
boolean = BoolSelector(true)
string = StringInput("Test")
duplicateSheet = Sheet.DuplicateSheet(sheet=sheets, duplicateWithContents=boolean, duplicateWithView=boolean, prefix=string)
views = Sheet.Views(sheet=duplicateSheet)
