# Dynamo graph CanCheckIfPointIsInsideSpace.dyn (Dynamo 2.6.0.7237)

select_model_element = DSModelElementSelection()  # 1 picked in the model
code_block = CodeBlock { Point.ByCoordinates(-6166.333, 6435.025, 0.000); Point.ByCoordinates(-6166.333, 383.025, 0.000); }
isInsideSpace = Space.IsInsideSpace(space=select_model_element, point=code_block.out1)
