# Dynamo graph CanGetSetDiscipline.dyn (Dynamo 2.6.1.9130)

views = Views("{3D}")
string = StringInput("Structural")
setDiscipline = View.SetDiscipline(view=views, discipline=string)
discipline = View.Discipline(view=setDiscipline)
