# Dynamo graph CanGetSetDisplayStyle.dyn (Dynamo 2.6.1.9130)

views = Views("{3D}")
string = StringInput("Shading")
setDisplayStyle = View.SetDisplayStyle(view=views, displayStyle=string)
displaystyle = View.Displaystyle(view=setDisplayStyle)
