# Dynamo graph CanGetSetPartsVisibility.dyn (Dynamo 2.6.1.9130)

views = Views("{3D}")
string = StringInput("ShowPartsAndOriginal")
setPartsVisibility = View.SetPartsVisibility(view=views, partsVisibility=string)
partsvisibility = View.Partsvisibility(view=setPartsVisibility)
